# Grasshopper definition Savill_hops.gh (Grasshopper 1.0.7)
# plug-ins: LunchBox, Kangaroo2 Components, Human, MeshEdit Components, ShapeDiverForGrasshopper, Pufferfish, Karamba3D

sddp = ShapeDiverDocumentPayload({AbsoluteTolerance=0, AngleTolerance=0, DistanceDisplayPrecision=0, GltfVersion="Gltf2", GrasshopperVersion="1.0.0007", InputGroups="{}", OutputGroups="{}", RelativeTolerance=0, RhinoVersion="7.34.23267.11001", UnitSystem=0, VersionCreated="1.14.0.0", VersionSaved="1.16.0.0"})
number_slider = Slider(25, range=0..200)  # disabled
number_slider_2 = Slider(90, range=0..200)  # disabled
pt = ConstructPoint(XCoordinate=0, YCoordinate=0, ZCoordinate=0)  # disabled

# ---- group: BUILDING FOOTPRINT
division = Division(B=2)  # disabled
unit_x = UnitX(Factor=division)  # disabled
unit_x_2 = UnitX(Factor=1)  # disabled
division_2 = Division(B=2)  # disabled
move = Move(Motion=unit_x_2)  # -> Geometry, Transform; disabled
move_2 = Move(Motion=unit_x)  # -> Geometry, Transform; disabled
unit_y = UnitY(Factor=division_2)  # disabled
reverse = Reverse(Vector=unit_y)  # disabled
move_3 = Move(Geometry=move_2.Geometry, Motion=reverse)  # -> Geometry, Transform; disabled
move_4 = Move(Geometry=move_2.Geometry, Motion=unit_y)  # -> Geometry, Transform; disabled
arc_3pt = Arc3Pt(PointB=move_3.Geometry, PointC=move.Geometry)  # -> Arc, Plane, Radius; disabled
arc_3pt_2 = Arc3Pt(PointB=move_4.Geometry, PointC=move.Geometry)  # -> Arc, Plane, Radius; disabled
join_curves = JoinCurves(Curves=[arc_3pt_2.Arc, arc_3pt.Arc], Preserve=False)  # disabled

# ----
relay = Relay()  # disabled
relay_2 = Relay()  # disabled

# ---- group: NO LONGER IN USE / GENERATE GRID
number_slider_3 = Slider(1.03, range=0..10)  # disabled
number_slider_4 = Slider(2, range=0..10)  # disabled
number_slider_5 = Slider(2, range=0..10)  # disabled
boundary_surfaces = BoundarySurfaces(Edges=join_curves)  # disabled
bounding_box = BoundingBox(Content=boundary_surfaces, Plane=PlaneXY(0, 0, 0), UnionBox=True)  # -> Box, Box_2; disabled
square_root = SquareRoot(Value=number_slider_4)  # disabled
square_root_2 = SquareRoot(Value=number_slider_5)  # disabled
multiplication = Multiplication(A=relay_2, B=number_slider_3)  # disabled
multiplication_2 = Multiplication(A=relay, B=number_slider_3)  # disabled
area = Area(Geometry=bounding_box.Box)  # -> Area, Centroid; disabled
division_3 = Division(A=multiplication, B=square_root)  # disabled
division_4 = Division(A=multiplication_2, B=square_root_2)  # disabled
scale = Scale(Geometry=bounding_box.Box, Center=area.Centroid, Factor=number_slider_3)  # -> Geometry, Transform; disabled
multiplication_3 = Multiplication(A=division_4, B=2)  # disabled
multiplication_4 = Multiplication(A=division_3, B=2)  # disabled
diagrid_structure = DiagridStructure(Surface=scale.Geometry, UDivisions=multiplication_4, VDivisions=multiplication_3, Type=True)  # -> StructureLines, StructureNodes; disabled

# ---- group: NO LONGER IN USE / GRID CHECK
# this should be close to 2
list_item = ListItem(List=diagrid_structure.StructureNodes, Index=0, Wrap=True)  # -> Item, Item1, Item2; disabled
point = Point(list_item.Item)  # disabled
point_2 = Point(list_item.Item1)  # disabled
distance = Distance(PointA=point, PointB=point_2)  # disabled
square = Square(Value=distance)  # disabled
panel = Panel(square)  # disabled

# ----
number_slider_6 = Slider(90, range=0..100)
number_slider_7 = Slider(20, range=0..100)
xy_plane = XYPlane(Origin=Point(0, 0, 0))
number_slider_8 = Slider(100, range=0..100)
number_slider_9 = Slider(100, range=0..100)
number_slider_10 = Slider(830, range=0..1000)
unit_z = UnitZ(Factor=Slider(15, range=0..100))
merge = Merge()  # -> flatten(Result)
number_slider_11 = Slider(0.165, range=0..1)
number_slider_12 = Slider(0.119, range=0..1)  # disabled
swatch = ColourSwatch(SwatchColor=RGB(79, 79, 79))
boolean_toggle = BooleanToggle(True)
number_slider_13 = Slider(0.003, range=0..1)
number_slider_14 = Slider(0.035, range=0..1)
Z = UnitZ(Factor=Slider(0.035, range=0.003..0.035))

# ---- group: THE EDGE BEAM CURVE
curve = Curve(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)
edgecurve = GetGeometry(curve, AtLeast=1, AtMost=1, DeleteInput=False, Filter=1073741828, TreeAccess=False)
number_slider_15 = Slider(45, range=0..100)

# ----
explode = Explode(Curve=edgecurve, Recursive=True)  # -> Segments, Vertices

# ---- group: DEFORMING THE EDGE BEAM
explode_2 = Explode(Curve=edgecurve, Recursive=True)  # -> Segments, Vertices
dispatch = Dispatch(List=explode_2.Segments, DispatchPattern=[True, False])  # -> ListA, ListB
number_slider_16 = Slider(80, range=0..100)
divide_curve = DivideCurve(Curve=explode_2.Segments, Count=Slider(90, range=0..100), Kinks=False)  # -> Points, Tangents, Parameters
flip_curve = FlipCurve(Curve=dispatch.ListB)  # -> Curve, Flag
explode_tree = ExplodeTree(Data=divide_curve.Points)  # -> Branch0, Branch1
divide_curve_2 = DivideCurve(Curve=[flip_curve.Curve, dispatch.ListA], Count=number_slider_16, Kinks=False)  # -> Points, Tangents, Parameters
line = Line(StartPoint=explode_tree.Branch0, EndPoint=reverse(explode_tree.Branch1))
curve_middle = CurveMiddle(Curve=line)
pi = Pi(Factor=Slider(4.184, range=4..4.5))
nurbs_curve = NurbsCurve(Vertices=curve_middle, Degree="2", Periodic=False)  # -> Curve, Length, Domain
negative = Negative(Value=pi)
divide_curve_3 = DivideCurve(Curve=nurbs_curve.Curve, Count=number_slider_16, Kinks=False)  # -> Points, Tangents, Parameters
multiplication_5 = Multiplication(A=negative, B=divide_curve_3.Parameters)
subtraction = Subtraction(A=multiplication_5, B=Slider(45, range=-45..45))
sine = Sine(Value=degrees(subtraction))
list_item_2 = ListItem(List=sine, Index=0, Wrap=True)  # -> Item1, Item
panel_2 = Panel(list_item_2.Item1)
panel_3 = Panel(list_item_2.Item)
multiplication_6 = Multiplication(A=sine, B=Slider(2, range=0..3))
unit_z_2 = UnitZ(Factor=multiplication_6)
move_5 = Move(Geometry=divide_curve_2.Points, Motion=unit_z_2)  # -> Geometry, Transform
nurbs_curve_2 = NurbsCurve(Vertices=move_5.Geometry, Degree="2", Periodic=False)  # -> Curve, Length, Domain
join_curves_2 = JoinCurves(Curves=flatten(nurbs_curve_2.Curve), Preserve=False)
custom_preview_lineweights = CustomPreviewLineweights(
    Geometry=nurbs_curve_2.Curve,
    Shader=ColourSwatch(SwatchColor=RGB(0, 162, 255)),
    Thickness=Slider(8.3, range=0..10),
    Absolute=False)
explode_tree_2 = ExplodeTree(Data=nurbs_curve_2.Curve)  # -> _0000, _0001
ruled_surface = RuledSurface(CurveA=explode_tree_2._0000, CurveB=explode_tree_2._0001)

# ----
curve_middle_2 = CurveMiddle(Curve=explode.Segments)

# ---- group: THE EDGE BEAM CURVE (continued)
rotate = Rotate(Geometry=join_curves_2, Angle=degrees(number_slider_15), Plane=PlaneXY(0, 0, 0))  # -> Geometry, Transform

# ----
rotate_2 = Rotate(Geometry=ruled_surface, Angle=degrees(number_slider_15), Plane=PlaneXY(0, 0, 0))  # -> Geometry, Transform

# ---- group: THE LATHE MESH
bounding_box_2 = BoundingBox(Content=rotate_2.Geometry, Plane=PlaneXY(0, 0, 0), UnionBox=True)  # -> Box, Box_2
deconstruct_brep = DeconstructBrep(Brep=bounding_box_2.Box)  # -> Faces, Edges, Vertices
deconstruct_box = DeconstructBox(Box=rotate.Geometry)  # -> Plane, X, Y, Z
deconstruct_domain = DeconstructDomain(Domain=deconstruct_box.X)  # -> Start, End
list_item_3 = ListItem(List=deconstruct_brep.Faces, Index=Slider(4, range=0..10), Wrap=True)
round = Round(Number=deconstruct_domain.End)  # -> Nearest, Floor, Ceiling
area_2 = Area(Geometry=list_item_3)  # -> Area, Centroid
division_5 = Division(A=round.Ceiling, B=deconstruct_domain.End)
scale_2 = Scale(Geometry=list_item_3, Center=area_2.Centroid, Factor=division_5)  # -> Geometry, Transform
mesh_surface = MeshSurface(Surface=scale_2.Geometry, UCount=round.Ceiling, VCount=round.Ceiling, Overhang=Toggle(False), Equalize=Toggle(True))
deconstruct_mesh = DeconstructMesh(Mesh=mesh_surface)  # -> Vertices, Faces, Colours, Normals

# ----
area_3 = Area(Geometry=ruled_surface)  # -> Area, Centroid
scale_3 = Scale(Geometry=ruled_surface, Center=area_3.Centroid, Factor=Slider(1.03, range=0..2))  # -> Geometry, Transform
bbox = BoundingBox(Content=scale_3.Geometry, Plane=PlaneXY(0, 0, 0))  # -> Box, Box_2
debrep = DeconstructBrep(Brep=bbox.Box)  # -> Faces, Edges, Vertices
area_4 = Area(Geometry=debrep.Faces)  # -> Area, Centroid
pdecon = Deconstruct(Point=area_4.Centroid)  # -> XComponent, YComponent, ZComponent
int = Integer(pdecon.ZComponent)
bnd = Bounds(Numbers=int)
dedomain = DeconstructDomain(Domain=bnd)  # -> Start, End
equals = Equality(FirstNumber=int, SecondNumber=dedomain.Start)  # -> Equality, Inequality
dispatch_2 = Dispatch(List=debrep.Faces, DispatchPattern=equals.Equality)  # -> ListA, ListB
meter = Panel("1")
debrep_2 = DeconstructBrep(Brep=dispatch_2.ListA)  # -> Faces, Edges, Vertices
divlength = DivideLength(Curve=debrep_2.Edges, Length=meter)  # -> Points, Tangents, Parameters
lng = ListLength(List=divlength.Points)  # -> flatten(Length)
divide = DivideCurve(Curve=debrep_2.Edges, Count=lng, Kinks=False)  # -> simplify(Points), Tangents, Parameters

divide_curve_4 = DivideCurve(Curve=explode_tree_2._0001, Count=number_slider_6, Kinks=False)  # -> Points, Tangents, Parameters
divide_curve_5 = DivideCurve(Curve=explode_tree_2._0000, Count=number_slider_6, Kinks=False)  # -> Points, Tangents, Parameters
project = Project(Geometry=rotate.Geometry, Plane=list_item_3)  # -> Geometry, Transform
shift_list = ShiftList(List=divide_curve_5.Points, Shift=number_slider_7, Wrap=False)
shift_list_2 = ShiftList(List=divide_curve_4.Points, Shift=number_slider_7, Wrap=False)
disc = Discontinuity(Curve=deconstruct_brep.Edges, Level=1)  # -> Points, Parameters; disabled
area_5 = Area(Geometry=project.Geometry)  # -> Area, Centroid
line_2 = Line(StartPoint=divide_curve_5.Points, EndPoint=shift_list_2)
line_3 = Line(StartPoint=shift_list, EndPoint=divide_curve_4.Points)
scale_4 = Scale(Geometry=project.Geometry, Center=area_5.Centroid, Factor=Slider(0.98, range=0..1))  # -> Geometry, Transform
split_list = SplitList(List=line_3, Index="71")  # -> ListA, ListB
split_list_2 = SplitList(List=line_2, Index="71")  # -> ListA, ListB
explode_3 = Explode(Curve=scale_4.Geometry, Recursive=True)  # -> Segments, Vertices
mesh_edges = MeshEdges(Mesh=mesh_surface)  # -> NakedEdges, InteriorEdges, NonManifoldEdges
nakedvertices = NakedVertices(Mesh=mesh_surface)  # -> ClothedIndex, NakedIndex, ClothedPts, NakedPts
point_in_curve = PointInCurve(Point=deconstruct_mesh.Vertices, Curve=project.Geometry)  # -> Relationship, Point
point_in_curve_2 = PointInCurve(Point=deconstruct_mesh.Vertices, Curve=scale_4.Geometry)  # -> Relationship, Point
curve_2 = Curve(split_list.ListA)

# ---- group: KARAMBA
material_selection_karamba3d = MaterialSelectionKaramba3D(menu=[dropdown(4), dropdown(1)])
cross_section_karamba3d = CrossSectionKaramba3D(
    FamilyNameOfCrossSection="DefaultCroSec",
    Material=material_selection_karamba3d,
    Height_cm="8",
    UpperFlangeWidth_cm="5",
    LowerFlangeWidth_cm="5",
    UpperFlangeThickness_cm=0.8,
    LowerFlangeThickness_cm=0.8,
    WebThickness_cm=0.5,
    FilletRadius_cm=0,
    mode="I")
line_to_beam_karamba3d = LineToBeamKaramba3D(
    Line=flatten(curve_2),
    Colour=ColourSwatch(SwatchColor=RGB(0, 204, 255)),
    Identifier="LeftLathes",
    CrossSection=cross_section_karamba3d,
    New=True,
    Remove=True,
    LimitDistance_m=0.005,
    Bending=True,
    SetBucklingLength=True,
    ToPolylineMaxAngle=0.03,
    ToPolylineTolerance=0.01,
    ToPolylineMaxEdgeLength=0.25)  # -> Element, Points, Info
line_to_beam_karamba3d_2 = LineToBeamKaramba3D(
    Line=flatten(split_list_2.ListA),
    Colour=ColourSwatch(SwatchColor=RGB(255, 0, 0)),
    Identifier="RightLathes",
    CrossSection=cross_section_karamba3d,
    New=True,
    Remove=True,
    LimitDistance_m=0.005,
    Bending=True,
    SetBucklingLength=True,
    ToPolylineMaxAngle=0.03,
    ToPolylineTolerance=0.01,
    ToPolylineMaxEdgeLength=0.25)  # -> Element, Points, Info
unit_z_3 = UnitZ(Factor=Slider(0.001, range=0..0.001))
support_karamba3d = SupportKaramba3D(PosInd=[divide_curve_5.Points, divide_curve_4.Points], menu=[buttons(on, on, on, off, off, off)])
beam_loads_karamba3d = BeamLoadsKaramba3D(
    BeamIdentifier=[line_to_beam_karamba3d.Element, line_to_beam_karamba3d_2.Element],
    LoadCase="LC0",
    ForceVector=unit_z_3,
    TStart=0,
    TEnd=1,
    mode="Block",
    menu=[buttons(off, on, off)])  # -> flatten(Load)
beam_joint_agent_karamba3d = BeamJointAgentKaramba3D(
    AtElementIdentifiers=line_to_beam_karamba3d.Element,
    ToElementIdentifiers=line_to_beam_karamba3d_2.Element,
    Ct_kN_m=Vector(0, 0, 0),
    Cr_kNm_rad=Vector(0, 0, 0),
    menu=[buttons(on, on, on, on, on, on)])
assemble_model_karamba3d = AssembleModelKaramba3D(
    Point=flatten(line_to_beam_karamba3d.Points),
    Elem=flatten([line_to_beam_karamba3d.Element, line_to_beam_karamba3d_2.Element]),
    Support=flatten(support_karamba3d),
    Load=beam_loads_karamba3d,
    CrossSection=cross_section_karamba3d,
    Material=material_selection_karamba3d,
    Joint=beam_joint_agent_karamba3d,
    LimitDistance_m=0.005)  # -> Model, Info, Mass_kg, CentreOfGravity, LoadCaseNames
analyse_karamba3d = AnalyseKaramba3D(Model=assemble_model_karamba3d.Model)  # -> AnalysedModel, MaximumDisplacement_cm, ResultingForce_kN, ChangeOfElasticEnergy_kNm
model_view_karamba3d = ModelViewKaramba3D(Model=analyse_karamba3d.AnalysedModel)  # -> Model, DeformedMesh, DeformedAxes, DeformedModel, MaximumDeformation

# ----
bang = ExplodeTree(Data=divide.Points)  # -> Branch0, Branch1, Branch2, Branch3
divide_curve_6 = DivideCurve(Curve=explode_3.Segments, Count=Slider(90, range=0..100), Kinks=True)  # -> Points, Tangents, Parameters
trim_with_region = TrimWithRegion(Curve=mesh_edges.InteriorEdges, Region=rotate.Geometry, Plane=xy_plane)  # -> Inside, Outside
dispatch_3 = Dispatch(List=deconstruct_mesh.Vertices, DispatchPattern=point_in_curve_2.Relationship)  # -> ListA, ListB
cull_pattern = CullPattern(List=deconstruct_mesh.Vertices, CullPattern=point_in_curve.Relationship)

# ---- group: GIRDLE LOAD
curve_3 = Curve(<curve referenced from the Rhino model>)  # disabled
number_slider_17 = Slider(0.6, range=0..1)  # disabled
curve_closest_point = CurveClosestPoint(Point=cull_pattern, Curve=curve_3)  # -> Point, Parameter, Distance; disabled
number_slider_18 = Slider(69, range=0..1000)  # disabled
smaller_than = SmallerThan(FirstNumber=curve_closest_point.Distance, SecondNumber=number_slider_17)  # -> SmallerThan, OrEqualTo; disabled
negative_2 = Negative(Value=number_slider_18)  # disabled
boolean_toggle_2 = BooleanToggle(False)  # disabled
boolean_toggle_3 = BooleanToggle(True)  # disabled
cull_pattern_2 = CullPattern(List=cull_pattern, CullPattern=smaller_than.SmallerThan)  # disabled
unit_z_4 = UnitZ(Factor=negative_2)  # disabled
load = Load(Point=cull_pattern_2, ForceVector=unit_z_4, Weighting=1)  # disabled

# ----
merge_2 = Merge(Data1=flatten(bang.Branch2), Data2=flatten(bang.Branch3))
merge_3 = Merge(Data1=flatten(bang.Branch0), Data2=flatten(bang.Branch1))
merge_4 = Merge(Data1=flatten(bang.Branch1), Data2=flatten(bang.Branch2))
merge_5 = Merge(Data1=flatten(bang.Branch3), Data2=flatten(bang.Branch0))
point_3 = Point(divide_curve_6.Points)
shift = ShiftList(List=merge_2, Shift=Slider(69, range=0..100), Wrap=True)
shift_2 = ShiftList(List=merge_5, Shift=Slider(50, range=0..100), Wrap=True)

# ---- group: EDGE BEAM RESTRAINT
pull_point = PullPoint(Point=point_3, Geometry=dispatch_3.ListB, ClosestOnly=True)  # -> ClosestPoint, Distance
point_4 = Point(pull_point.ClosestPoint)
point_list = PointList(Points=point_4, Size=Slider(0.6, range=0..10))
boolean_toggle_4 = BooleanToggle(True)
oncurve = OnCurve(Points=flatten(point_4), Curve=rotate.Geometry, Strength=Slider(1000, range=0..1000))
anchorxyz = AnchorXYZ(Point=point_4, X=boolean_toggle_4, Y=boolean_toggle_4, Z=Toggle(False), Strength=1000)

# ----
ln = Line(StartPoint=merge_4, EndPoint=reverse(shift_2))
ln_2 = Line(StartPoint=merge_3, EndPoint=reverse(shift))

# ---- group: LATERAL RESTRAINT
anchor = Anchor(Point=nakedvertices.NakedPts, Strength=Slider(5000, range=0..10000))  # disabled

# ----
rod = Rod(
    Polyline=mesh_edges.InteriorEdges,
    LengthFactor=1,
    AngleFactor=1,
    AxialStrength=number_slider_10,
    BendStrength=number_slider_10)
merge_6 = Merge(Data1=flatten(ln), Data2=flatten(ln_2))
explode_4 = Explode(Curve=rotate.Geometry, Recursive=True)  # -> Segments, Vertices
srfsplit = SurfaceSplit(Surface=ruled_surface, Curves=merge_6)
load_2 = Load(Point=cull_pattern, ForceVector=unit_z, Weighting=1)
edgelengths = EdgeLengths(Mesh=mesh_surface, LengthFactor=Slider(1, range=0..10), Strength=Slider(5000, range=0..10000))
show = Show(G=[mesh_surface, point_4])
debrep_3 = DeconstructBrep(Brep=srfsplit)  # -> Faces, Edges, Vertices
merge_7 = Merge(Data1=explode_tree_2._0000, Data2=explode_tree_2._0001)
sort_pts = SortDuplicatePoints(Points=flatten(debrep_3.Vertices))  # -> UniquePoints, Indices
join = JoinCurves(Curves=flatten(merge_7), Preserve=False)
crv_cp = CurveClosestPoint(Point=sort_pts.UniquePoints, Curve=join)  # -> Point, Parameter, Distance
smaller = SmallerThan(FirstNumber=crv_cp.Distance, SecondNumber="0.00001")  # -> SmallerThan, OrEqualTo
dispatch_4 = Dispatch(List=sort_pts.UniquePoints, DispatchPattern=smaller.SmallerThan)  # -> ListA, ListB
dots = DotDisplay(Point=dispatch_4.ListA, Colour=swatch, Size=number_slider_11)
dots_2 = DotDisplay(Point=dispatch_4.ListB, Colour=ColourSwatch(SwatchColor=RGB(150, 150, 150)), Size=number_slider_12)  # disabled

# ---- group: Standarize quad Normals
clean = CombineClean(Meshes=srfsplit)
unifynormals = MeshUnifyNormals(Mesh=clean)

# ----
previewlw = CustomPreviewLineweights(Geometry=debrep.Edges, Shader=swatch, Thickness=expr("x*10", number_slider_11), Absolute=False)
previewlw_2 = CustomPreviewLineweights(Geometry=debrep_3.Edges, Shader=swatch, Absolute=False)
mesh_join = MeshJoin(Meshes=unifynormals)
mesh_closest_point = MeshClosestPoint(Point=dispatch_4.ListA, Mesh=mesh_join)  # -> Point, Index, Parameter
nakedvertices_2 = NakedVertices(Mesh=unifynormals)  # -> ClothedIndex, NakedIndex, ClothedPts, NakedPts
point_5 = Point(nakedvertices_2.NakedPts)
demesh = DeconstructMesh(Mesh=mesh_join)  # -> Vertices, Faces, Colours, Normals
edgelengths_2 = EdgeLengths(Mesh=mesh_join, LengthFactor=Slider(0.74, range=0..1), Strength=Slider(1, range=0..1000))
anchor_2 = Anchor(Point=mesh_closest_point.Point, Strength=10000)
load_3 = Load(Point=demesh.Vertices, ForceVector=Z, Weighting=1)
show_2 = Show(G=mesh_join)
entwine = Entwine(Branch00=show_2, Branch01=[anchor_2, edgelengths_2, load_3], FlattenInputs=True)  # -> flatten(Result)
solver = Solver(GoalObjects=entwine, Reset=Button(), Threshold=1e-15, Tolerance=0.0001, On=Toggle(False))  # -> I, V, O
item = ListItem(List=solver.O, Index=0, Wrap=True)
clean_2 = CombineClean(Meshes=item)
msh2psrf = MeshToPolysurface(Mesh=clean_2, Triangles=False, FaceMerge=False)
project_2 = Project(Curve=merge_6, Brep=msh2psrf, Direction=Vector(0, 0, 1))
previewlw_3 = CustomPreviewLineweights(Geometry=project_2, Shader=ColourSwatch(SwatchColor=RGB(74, 74, 74)), Absolute=False)

# ---- group: SOLVER
merge_8 = Merge(Data1=show, Data2=[load_2, edgelengths, oncurve, anchorxyz], Data3=anchor, Data4=rod)
solver_2 = Solver(GoalObjects=flatten(merge_8), Reset=Button(), Threshold=1e-15, Tolerance=0.0001, On=Toggle(False))  # -> I, V, O

# ----
clean_tree = CleanTree(RemoveNulls=boolean_toggle, RemoveInvalid=boolean_toggle, RemoveEmpty=boolean_toggle, Tree=solver_2.O)

# ---- group: SOLVER (continued)
list_item_4 = ListItem(List=clean_tree, Index="0", Wrap=True)
mesh = Mesh(list_item_4)

# ----
point_6 = Point(clean_tree)
clean_tree_2 = CleanTree(RemoveNulls=boolean_toggle, RemoveInvalid=boolean_toggle, RemoveEmpty=boolean_toggle, Tree=point_6)

# ---- group: DISPLAY
mesh_edges_2 = MeshEdges(Mesh=mesh)  # -> NakedEdges, InteriorEdges, NonManifoldEdges
xy_plane_2 = XYPlane(Origin=Point(0, 0, 0))
trim_with_region_2 = TrimWithRegion(Curve=mesh_edges_2.InteriorEdges, Region=rotate.Geometry, Plane=xy_plane_2)  # -> Inside, Outside
custom_preview_lineweights_2 = CustomPreviewLineweights(
    Geometry=trim_with_region_2.Inside,
    Shader=ColourSwatch(SwatchColor=RGB(252, 43, 43)),
    Thickness=Slider(2, range=0..10),
    Absolute=False)

# ----
context_bake = ContextBake(Savill_roof=mesh)  # disabled
point_list_2 = PointList(Points=clean_tree_2, Size=Slider(0.7, range=0..10))
