# Grasshopper definition Spikey_hops.gh (Grasshopper 1.0.7)
# Spherical spikey thing

redius = GetNumber(Slider(33.927, range=0..100), AtLeast=1, AtMost=1, Maximum=1.797693135e+308, Minimum=-1.797693135e+308, TreeAccess=False)
cir = Circle(Plane=PlaneXY(0, 0, 0), Radius=redius)
length = GetNumber(Slider(5, range=0..100), AtLeast=1, AtMost=1, Maximum=1.797693135e+308, Minimum=-1.797693135e+308, TreeAccess=False)
count = GetInteger(Slider(16.72, range=0..100), AtLeast=1, AtMost=1, Maximum=2147483647, Minimum=-2147483648, TreeAccess=False)
scale = Scale(Geometry=cir, Center=Point(0, 0, 0), Factor=length)  # -> Geometry, Transform
divide = DivideCurve(Curve=cir, Count=count, Kinks=False)  # -> Points, Tangents, Parameters
divide_2 = DivideCurve(Curve=scale.Geometry, Count=count, Kinks=False)  # -> Points, Tangents, Parameters
ln = Line(StartPoint=divide.Points, EndPoint=divide_2.Points)
curvepoint = PointOnCurve(ln, parameter=0.4)
Z = UnitZ(Factor=1)
lng = ListLength(List=divide.Points)
pi = Pi(Factor=Slider(2.24, range=0..100))
pl = ConstructPlane(Origin=curvepoint, XAxis=curvepoint, YAxis=Z)
range = Range(Domain=pi, Steps=lng)
cull_i = CullIndex(List=range, Indices=Slider(0, range=0..100), Wrap=True)
sin = Sine(Value=cull_i)
rotate = Rotate(Geometry=ln, Angle=cull_i, Plane=pl)  # -> Geometry, Transform
bnd = Bounds(Numbers=sin)
dom = ConstructDomain(DomainStart=Slider(0.628, range=0..100), DomainEnd=Slider(0.784, range=0..100))
remap = RemapNumbers(Value=sin, Source=bnd, Target=dom)  # -> Mapped, Clipped
scale_2 = Scale(Geometry=rotate.Geometry, Center=pl, Factor=remap.Mapped)  # -> Geometry, Transform
loft = Loft(Curves=scale_2.Geometry, Options={Adjust=False, Closed=True, LoftEnds=0, LoftSimp=0, LoftType=0, Rebuild=10, Refit=0.01})
brep = Brep(loft)
offset = OffsetSurface(Surface=brep, Distance=Slider(2, range=0..100), Retrim=True)
edges = BrepEdges(Brep=brep)  # -> Naked, Interior, NonManifold
edges_2 = BrepEdges(Brep=offset)  # -> Naked, Interior, NonManifold
rulesrf = RuledSurface(CurveA=edges.Naked, CurveB=edges_2.Naked)
merge = Merge(Data1=rulesrf, Data2=offset, Data3=brep)
subd = SubD(merge)

# ---- group: RH_OUT:subD
subd_2 = SubD(subd)  # disabled

# ----
context_bake = ContextBake(Geometry=subd)
