# Grasshopper definition Spikey_setup (1).gh (Grasshopper 1.0.7)
# plug-ins: Hops

hops = Hops(
    Count=Slider(10, range=0..10),
    Redius=Slider(5, range=0..10),
    Length=Slider(9, range=0..10),
    CacheResultsInMemory=True,
    CacheSolveResults=True,
    RemoteDefinitionLocation="C:\Users\saeed\OneDrive\Documents\Spikey_hops.gh",
    RemoteSolveVersion=(0, 1, 0),
    ShowInput_Enabled=False,
    ShowInput_Path=False,
    SynchronousSolve=True)
